# Grasshopper definition Graph.TemperatureRange.ghx (Grasshopper 1.0.7)

path = FilePath("/Users/yukio/Documents/GitHub/GH-FuncBase/[Graph]/Temperature Range/参考文件测试.csv")
file = ReadFile(File=path, PerLineParse=True)
panel = Panel(file)
split = TextSplit(Text=panel, Separators=",")  # -> simplify(Result)
lng = ListLength(List=split)  # -> flatten(Length)
bnd = Bounds(Numbers=lng)
dedomain = DeconstructDomain(Domain=bnd)  # -> Start, End
culln = CullNth(List=split, CullFrequency=dedomain.End)
panel_2 = Panel(culln)
flip = FlipMatrix(Data=culln)
panel_3 = Panel(flip)
